# Dynamo graph Project Purge tool_script.dyn (Dynamo 2.13.1.3887)
# packages: Data-Shapes 2025.3.118, Crumple 2024.4.3

code_block = CodeBlock { "Purge Unused Elements"; "Delete"; "Cancel"; 1010; 440; }
file_path = Filename("..\..\..\..\AppData\Roaming\pyRevit\Extensions\AA.extension\AA.tab\5f234.png")
code_block_2 = CodeBlock { "All Ref Planes"; "Run"; false; 100; }
categories = Categories("OST_CLines")
all_elements_of_category = ElementsOfCategory(Category=categories)
name = Element.Name(element=all_elements_of_category)
listview_data = Custom[Listview Data](InputName=code_block_2.out0, Keys=name, Values=all_elements_of_category, Height_optionnal=code_block_2.out3, ShowId_optionnal=code_block_2.out2)  # package Data-Shapes; Create data for ListView input in UI.MultiInputForm ++ . Check out www.data-shapes.net for more infos.
code_block_3 = CodeBlock { "All Scope Boxes"; "Run"; false; 70; }
categories_2 = Categories("OST_VolumeOfInterest")
all_elements_of_category_2 = ElementsOfCategory(Category=categories_2)
name_2 = Element.Name(element=all_elements_of_category_2)
listview_data_2 = Custom[Listview Data](InputName=code_block_3.out0, Keys=name_2, Values=all_elements_of_category_2, Height_optionnal=code_block_3.out3, ShowId_optionnal=code_block_3.out2)
code_block_4 = CodeBlock { "View Templates"; "Run"; false; 100; }
audit_viewtemplates = Custom[© Audit.ViewTemplates]()  # package Crumple; Returns all view templates in the document which are not in use by views or view types. If you set the purge to true, it will attempt to delete them also.
name_3 = Element.Name(element=audit_viewtemplates.viewTemplates)
listview_data_3 = Custom[Listview Data](InputName=code_block_4.out0, Keys=name_3, Values=audit_viewtemplates.viewTemplates, Height_optionnal=code_block_4.out3, ShowId_optionnal=code_block_4.out2)
code_block_5 = CodeBlock { "Levels"; "Run"; false; 70; }
categories_3 = Categories("OST_Levels")
all_elements_of_category_3 = ElementsOfCategory(Category=categories_3)
name_4 = Element.Name(element=all_elements_of_category_3)
listview_data_4 = Custom[Listview Data](InputName=code_block_5.out0, Keys=name_4, Values=all_elements_of_category_3, Height_optionnal=code_block_5.out3, ShowId_optionnal=code_block_5.out2)
code_block_6 = CodeBlock { "Filters"; "Run"; false; 80; }
element_classes = ElementTypes("FilterElement")
all_elements_of_class = ElementsOfType(element_class=element_classes)
name_5 = Element.Name(element=all_elements_of_class)
listview_data_5 = Custom[Listview Data](InputName=code_block_6.out0, Keys=name_5, Values=all_elements_of_class, Height_optionnal=code_block_6.out3, ShowId_optionnal=code_block_6.out2)
list_create = List.Create(item0=listview_data, item1=listview_data_2, item2=listview_data_3, item3=listview_data_4, item4=listview_data_5)
boolean = BoolSelector(true)
multipleinputform = Custom[MultipleInputForm ++](Description_optional=code_block.out0, Logo_optional=file_path, ButtonText_optional=code_block.out1, Inputs=list_create, Toggle=boolean, CancelButtonText_optional=code_block.out2, MaxHeight_optional=code_block.out3, Width_optional=code_block.out4)  # package Data-Shapes; Create a form with multiple inputs. see www.data-shapes.net for tutorials and infos!
code_block_7 = CodeBlock(out=multipleinputform.User_Inputs) { out[0]; out[1]; out[2]; out[3]; out[4]; }
delete = Element.Delete(element=code_block_7.out0)
delete_2 = Element.Delete(element=code_block_7.out1)
delete_3 = Element.Delete(element=code_block_7.out2)
delete_4 = Element.Delete(element=code_block_7.out3)
audit_viewfilters = Custom[© Audit.ViewFilters]()  # package Crumple; Returns all view filters in the document which are not in use by views or view templates. If you set the purge to true, it will attempt to delete them also.
code_block_8 = CodeBlock(a=code_block_7.out4) { a; }
delete_5 = Element.Delete(element=code_block_8)
