# Dynamo graph delete unused views& sections_script.dyn "delete unused sections_script" (Dynamo 2.19.3.6394)
# packages: Data-Shapes 2025.3.118, Crumple 2024.4.3

code_block = CodeBlock { "Delete Unused View/Sections"; "Run"; "Cancel"; 800; 500; }
file_path = Filename("..\..\..\..\AppData\Roaming\pyRevit\Extensions\AA.extension\AA.tab\5f234.png")
code_block_2 = CodeBlock { "V's Not on Sheets"; "Run"; false; }
audit_views = Custom[© Audit.Views]()  # package Crumple; Returns all views in the document which are not placed on sheets or dependent upon views placed on sheets (callout, dependent views). If you set the purge to true, it will attempt to delete them also.
string_from_object = FromObject(object=audit_views.views)
code_block_3 = CodeBlock { "Section"; }
contains = String.Contains(string=string_from_object, searchFor=code_block_3)
filterByBoolMask = List.FilterByBoolMask(list=audit_views.views, mask=contains)
listview_data = Custom[Listview Data](InputName=code_block_2.out0, Keys=filterByBoolMask.out, Values=filterByBoolMask.out, ShowId_optionnal=code_block_2.out2)  # package Data-Shapes; Create data for ListView input in UI.MultiInputForm ++ . Check out www.data-shapes.net for more infos.
code_block_4 = CodeBlock { "S's Not on Sheets"; "Run"; false; }
audit_views_2 = Custom[© Audit.Views]()
string_from_object_2 = FromObject(object=audit_views_2.views)
code_block_5 = CodeBlock { "Section"; }
contains_2 = String.Contains(string=string_from_object_2, searchFor=code_block_5)
filterByBoolMask_2 = List.FilterByBoolMask(list=audit_views_2.views, mask=contains_2)
listview_data_2 = Custom[Listview Data](InputName=code_block_4.out0, Keys=filterByBoolMask_2.in, Values=filterByBoolMask_2.in, ShowId_optionnal=code_block_4.out2)
list_create = List.Create(item0=listview_data, item1=listview_data_2)
boolean = BoolSelector(true)
multipleinputform = Custom[MultipleInputForm ++](Description_optional=code_block.out0, Logo_optional=file_path, ButtonText_optional=code_block.out1, Inputs=list_create, Toggle=boolean, CancelButtonText_optional=code_block.out2, MaxHeight_optional=code_block.out3, Width_optional=code_block.out4)  # package Data-Shapes; Create a form with multiple inputs. see www.data-shapes.net for tutorials and infos!
code_block_6 = CodeBlock(out=multipleinputform.User_Inputs) { out[0]; out[1]; }
delete = Element.Delete(element=code_block_6.out0)
delete_2 = Element.Delete(element=code_block_6.out1)
