# Dynamo graph Name Level & ScopeB_script.dyn (Dynamo 2.13.1.3887)
# packages: Data-Shapes 2025.3.118

# group: icon user selected
file_path = Filename("..\..\..\..\AppData\Roaming\pyRevit\Extensions\AA.extension\AA.tab\5f234.png")

# group: select level
code_block = CodeBlock { "Select Level"; false; 100; }
categories = Categories("OST_Levels")
all_elements_of_category = ElementsOfCategory(Category=categories)
name = Element.Name(element=all_elements_of_category)
listview_data = Custom[Listview Data](InputName=code_block.out0, Keys=name, Values=all_elements_of_category, Height_optionnal=code_block.out2, SortItems_optionnal=code_block.out1, ShowId_optionnal=code_block.out1)  # package Data-Shapes; Create data for ListView input in UI.MultiInputForm ++ . Check out www.data-shapes.net for more infos.

# group: rename level
code_block_2 = CodeBlock { "new name"; "Level  "; }
textbox_data = Custom[TextBox Data](InputName=code_block_2.out0, DefaultText=code_block_2.out1)  # package Data-Shapes; Create Data for TextBox input in UI.MultipleInputForm ++ . Check out www.data-shapes.net for more informations

# group: select scope box
code_block_3 = CodeBlock { "Select ScopeBoxes"; false; 100; }
categories_2 = Categories("OST_VolumeOfInterest")
all_elements_of_category_2 = ElementsOfCategory(Category=categories_2)
name_2 = Element.Name(element=all_elements_of_category_2)
listview_data_2 = Custom[Listview Data](InputName=code_block_3.out0, Keys=name_2, Values=all_elements_of_category_2, Height_optionnal=code_block_3.out2, SortItems_optionnal=code_block_3.out1, ShowId_optionnal=code_block_3.out1)

# group: rename scopebox
code_block_4 = CodeBlock { "new name"; "Zone  "; }
textbox_data_2 = Custom[TextBox Data](InputName=code_block_4.out0, DefaultText=code_block_4.out1)

list_create = List.Create(item0=listview_data, item1=textbox_data, item2=listview_data_2, item3=textbox_data_2)

# group: GUI
code_block_5 = CodeBlock { "Rename Levels & SBs"; "Run"; "Cancel"; false; true; }
multipleinputform = Custom[MultipleInputForm ++](Description_optional=code_block_5.out0, Logo_optional=file_path, ButtonText_optional=code_block_5.out1, Inputs=list_create, Toggle=code_block_5.out4, CancelButtonText_optional=code_block_5.out2)  # package Data-Shapes; Create a form with multiple inputs. see www.data-shapes.net for tutorials and infos!

code_block_6 = CodeBlock(out=multipleinputform.User_Inputs) { out[0]; out[1]; out[2]; out[3]; }

# group: output
code_block_7 = CodeBlock { "Name"; }
setParameterByName = Element.SetParameterByName(element=code_block_6.out0, parameterName=code_block_7, value=code_block_6.out1)
code_block_8 = CodeBlock { "Name"; }
setParameterByName_2 = Element.SetParameterByName(element=code_block_6.out2, parameterName=code_block_8, value=code_block_6.out3)
