# Dynamo graph Rename VS_script.dyn (Dynamo 2.13.1.3887)
# packages: Data-Shapes 2025.3.118

# group: icon user input
file_path = Filename("C:\Users\aadam\AppData\Roaming\pyRevit\Extensions\AA.extension\AA.tab\5f234.png")

# group: all views that are not legends - listed user selected
code_block = CodeBlock { "Views"; false; true; 200; }
categories = Categories("OST_Views")
all_elements_of_category = ElementsOfCategory(Category=categories)
isViewTemplate = View.IsViewTemplate()  # unwired: view
filter = List.Filter(list=all_elements_of_category, condition=isViewTemplate)
string_from_object = FromObject(object=filter.out)
string = StringInput("Legend")
contains = String.Contains(string=string_from_object, searchFor=string)
filterByBoolMask = List.FilterByBoolMask(list=filter.out, mask=contains)
flatten = List.Flatten(list=filterByBoolMask.out)
name = Element.Name(element=flatten)
listview_data = Custom[Listview Data](InputName=code_block.out0, Keys=name, Values=flatten, Height_optionnal=code_block.out3, ShowId_optionnal=code_block.out1)  # package Data-Shapes; Create data for ListView input in UI.MultiInputForm ++ . Check out www.data-shapes.net for more infos.

# group: sheets list user selected
code_block_2 = CodeBlock { "Sheets"; false; true; 200; }
categories_2 = Categories("OST_Sheets")
all_elements_of_category_2 = ElementsOfCategory(Category=categories_2)
name_2 = Element.Name(element=all_elements_of_category_2)
listview_data_2 = Custom[Listview Data](InputName=code_block_2.out0, Keys=name_2, Values=all_elements_of_category_2, Height_optionnal=code_block_2.out3, ShowId_optionnal=code_block_2.out1)

# group: chose existing words to replace - user input
code_block_3 = CodeBlock { "Search for"; }
textbox_data = Custom[TextBox Data](InputName=code_block_3)  # package Data-Shapes; Create Data for TextBox input in UI.MultipleInputForm ++ . Check out www.data-shapes.net for more informations

# group: replace words with - user input
code_block_4 = CodeBlock { "Replace with"; }
textbox_data_2 = Custom[TextBox Data](InputName=code_block_4)

list_create = List.Create(item0=listview_data, item1=listview_data_2, item2=textbox_data, item3=textbox_data_2)

# group: GUI
code_block_5 = CodeBlock { "Rename Views & Sheets"; "Run"; "Cancel"; 850; 650; true; }
multipleinputform = Custom[MultipleInputForm ++](Description_optional=code_block_5.out0, Logo_optional=file_path, ButtonText_optional=code_block_5.out1, Inputs=list_create, Toggle=code_block_5.out5, CancelButtonText_optional=code_block_5.out2, MaxHeight_optional=code_block_5.out3, Width_optional=code_block_5.out4)  # package Data-Shapes; Create a form with multiple inputs. see www.data-shapes.net for tutorials and infos!

code_block_6 = CodeBlock(out=multipleinputform.User_Inputs) { out[0]; out[1]; out[2]; out[3]; }
code_block_7 = CodeBlock { "View Name"; }
string_2 = StringInput("View Name")
getParameterValueByName = Element.GetParameterValueByName(element=code_block_6.out0, parameterName=string_2)
replace = String.Replace(string=getParameterValueByName, searchFor=code_block_6.out2, replaceWith=code_block_6.out3)

# group: view output
setParameterByName = Element.SetParameterByName(element=code_block_6.out0, parameterName=code_block_7, value=replace)

code_block_8 = CodeBlock { "Sheet Name"; }
string_3 = StringInput("Sheet Name")
getParameterValueByName_2 = Element.GetParameterValueByName(element=code_block_6.out1, parameterName=string_3)
replace_2 = String.Replace(string=getParameterValueByName_2, searchFor=code_block_6.out2, replaceWith=code_block_6.out3)

# group: sheet output
setParameterByName_2 = Element.SetParameterByName(element=code_block_6.out1, parameterName=code_block_8, value=replace_2)
