# Dynamo graph Replicate Legend_script.dyn (Dynamo 2.13.1.3887)
# packages: Data-Shapes 2025.3.118, Crumple 2024.4.3, Rhythm 2024.10.1

# group: icon user selected
file_path = Filename("..\..\5f234.png")

# group: Legend dropdown user selection
code_block = CodeBlock { "Legend to Place"; 0; }
legends = Python()  # CPython3; unwired: IN[0]
# ---------- legends.python (38 lines) ----------
#Copyright(c) 2017, john pierson
# @60secondrevit, http://sixtysecondrevit.com

import clr
clr.AddReference('ProtoGeometry')
from Autodesk.DesignScript.Geometry import *

# Import DocumentManager and TransactionManager
clr.AddReference("RevitServices")
import RevitServices
from RevitServices.Persistence import DocumentManager
from RevitServices.Transactions import TransactionManager

# Import RevitAPI
clr.AddReference("RevitAPI")
import Autodesk
from Autodesk.Revit.DB import *

doc = DocumentManager.Instance.CurrentDBDocument
uiapp = DocumentManager.Instance.CurrentUIApplication
app = uiapp.Application

from System.Collections.Generic import *


#The inputs to this node will be stored as a list in the IN variable.
dataEnteringNode = IN
collector = FilteredElementCollector(doc)
views = collector.OfCategory(BuiltInCategory.OST_Views).WhereElementIsNotElementType().ToElements()

leg = []
for i in views:
	if not i.IsTemplate:
		if i.ViewType == ViewType.Legend:
			leg.append(i)
	

OUT = leg
# ----------------------------------------
name = Element.Name(element=legends)
ui_dropdown_data = Custom[UI.DropDown Data](InputName=code_block.out0, Keys=name, Values=legends, DefaultValueIndex=code_block.out1)  # package Data-Shapes; Create data for DropDown input in UI.MultiInputForm ++ . Check out www.data-shapes.net for more infos.

# group: sheet list user selected
code_block_2 = CodeBlock { "Select Sheets"; "View Title"; false; 100; }
categories = Categories("OST_Sheets")
all_elements_of_category = ElementsOfCategory(Category=categories)
name_2 = Element.Name(element=all_elements_of_category)
code_block_3 = CodeBlock { "Splash"; }
contains = String.Contains(string=name_2, searchFor=code_block_3)
filterByBoolMask = List.FilterByBoolMask(list=all_elements_of_category, mask=contains)
sheetNumber = Sheet.SheetNumber(sheet=filterByBoolMask.out)
sheetName = Sheet.SheetName(sheet=filterByBoolMask.out)
code_block_4 = CodeBlock(a=sheetNumber, b=sheetName) { a+" - "+b; }
ui_listview_data = Custom[UI.Listview Data](InputName=code_block_2.out0, Keys=code_block_4, Values=filterByBoolMask.out, Height_optionnal=code_block_2.out3, SortItems_optionnal=code_block_2.out2)  # package Data-Shapes; Create data for ListView input in UI.MultiInputForm ++ . Check out www.data-shapes.net for more infos.

# group: view/legend title default no title
code_block_5 = CodeBlock { "View Title"; false; 1; }
collect_viewporttypes = Custom[© Collect.ViewportTypes]()  # package Crumple; Returns all viewport types and their names in the provided document.
ui_dropdown_data_2 = Custom[UI.DropDown Data](InputName=code_block_5.out0, Keys=collect_viewporttypes.names, Values=collect_viewporttypes.viewportTypes, DefaultValueIndex=code_block_5.out2, Sorted_optional=code_block_5.out1)

# group: legend to replicate user selected
code_block_6 = CodeBlock { "Template Legend"; }
code_block_7 = CodeBlock { "Click to Select Legend"; }
categories_2 = Categories("OST_Viewports")  # graph input
ui_selectmodelelements_data = Custom[UI.SelectModelElements Data](InputName=code_block_6, ButtonText=code_block_7, SelectSingleElement=categories_2)  # package Data-Shapes; Creates a Revit element selection input for UI.MultipleInputForm++ . Check out www.data-shapes.net for more infos!

create = List.Create(item0=ui_dropdown_data, item1=ui_listview_data, item2=ui_dropdown_data_2, item3=ui_selectmodelelements_data)

# group: GUI
code_block_8 = CodeBlock { "Replicate Legend On Sheets"; "Run"; true; "Cancel"; 450; }
place_legends_on_sheets = Custom[Place Legends on Sheets](Description_optional=code_block_8.out0, Logo_optional=file_path, ButtonText_optional=code_block_8.out1, Inputs=create, Toggle=code_block_8.out2, CancelButtonText_optional=code_block_8.out3, Width_optional=code_block_8.out4)  # package Data-Shapes; Create a form with multiple inputs. see www.data-shapes.net for tutorials and infos!

code_block_9 = CodeBlock(seq=place_legends_on_sheets.User_Inputs) { seq[1]; seq[0]; seq[2]; seq[3]; }
count = List.Count(list=code_block_9.out0)
cycle = List.Cycle(list=code_block_9.out0, amount=count)
cycle_2 = List.Cycle(list=code_block_9.out1, amount=count)
ʳʰʸᵗʰᵐ_viewport_locationdata = Rhythm.Revit.Elements.Viewport.LocationData(viewport=code_block_9.out3)
cycle_3 = List.Cycle(list=ʳʰʸᵗʰᵐ_viewport_locationdata.boxCenter, amount=count)

# group: output
ʳʰʸᵗʰᵐ_viewport_create = Rhythm.Revit.Elements.Viewport.Create(sheet=cycle, view=cycle_2, location=cycle_3)

code_block_10 = CodeBlock { "Type"; }
cycle_4 = List.Cycle(list=code_block_9.out2, amount=count)
setParameterByName = Element.SetParameterByName(element=ʳʰʸᵗʰᵐ_viewport_create, parameterName=code_block_10, value=cycle_4)
