# Dynamo graph Single View&Sheet-Dependents-UI-OTB_script.dyn (Dynamo 2.13.1.3887)
# packages: Crumple 2024.4.3, Data-Shapes 2025.3.118, Clockwork for Dynamo 3.x 3.3.0

# group: Icon user defined
file_path = Filename("..\..\5f234.png")

# group: Levels list user selection
code_block = CodeBlock { "Level"; 80; 0; false; }
element_types = ElementTypes("Level")
all_elements_of_type = ElementsOfType(element_class=element_types)
name = Level.Name(level=all_elements_of_type)
listview_data = Custom[Listview Data](InputName=code_block.out0, Keys=name, Values=all_elements_of_type, Height_optionnal=code_block.out1, DefaultValueIndices_optionnal=code_block.out2, SortItems_optionnal=code_block.out3, ShowId_optionnal=code_block.out3)  # package Data-Shapes; Create data for ListView input in UI.MultiInputForm ++ . Check out www.data-shapes.net for more infos.

# group: Scope boxes list user selection
code_block_2 = CodeBlock { "Scope Boxes"; 70; 0; false; }
code_block_3 = CodeBlock { Category.ByName("Scope Boxes"); }
all_elements_of_category = ElementsOfCategory(Category=code_block_3)
name_2 = Element.Name(element=all_elements_of_category)
listview_data_2 = Custom[Listview Data](InputName=code_block_2.out0, Keys=name_2, Values=all_elements_of_category, Height_optionnal=code_block_2.out1, DefaultValueIndices_optionnal=code_block_2.out2, ShowId_optionnal=code_block_2.out3)

# group: View templates dropdown user selection
code_block_4 = CodeBlock { "View Template"; }
categories = Categories("OST_Views")
all_elements_of_category_2 = ElementsOfCategory(Category=categories)
boolean = BoolSelector(false)
clean = List.Clean(list=all_elements_of_category_2, preserveIndices=boolean)
isViewTemplate = View.IsViewTemplate(view=clean)
filterByBoolMask = List.FilterByBoolMask(list=clean, mask=isViewTemplate)
name_3 = Element.Name(element=filterByBoolMask.in)
dropdown_data = Custom[DropDown Data](InputName=code_block_4, Keys=name_3, Values=filterByBoolMask.in)  # package Data-Shapes; Create data for DropDown input in UI.MultiInputForm ++ . Check out www.data-shapes.net for more infos.

# group: View name user text input
code_block_5 = CodeBlock { "View Name"; "Combined Layout"; }
textbox_data = Custom[TextBox Data](InputName=code_block_5.out0, DefaultText=code_block_5.out1)  # package Data-Shapes; Create Data for TextBox input in UI.MultipleInputForm ++ . Check out www.data-shapes.net for more informations

# group: sheet number
code_block_6 = CodeBlock { "Sheet no set"; "5000"; true; }
textbox_data_2 = Custom[TextBox Data](InputName=code_block_6.out0, DefaultText=code_block_6.out1, IsNumberEntry=code_block_6.out2)

# group: views on off
code_block_7 = CodeBlock { "View"; true; "Create view"; }
boolean_input = Custom[Boolean input](InputName=code_block_7.out0, DefaultValue=code_block_7.out1, SideText=code_block_7.out2)  # package Data-Shapes; Creates a boolean input for UI.MultipleInputForm ++ . Check out www.data-shapes.net for more infos!

# group: sheets on off
code_block_8 = CodeBlock { "Sheet"; true; "Create sheet (check both to add views to sheets)"; }
boolean_input_2 = Custom[Boolean input](InputName=code_block_8.out0, DefaultValue=code_block_8.out1, SideText=code_block_8.out2)

# group: title block dropdown user selected
code_block_9 = CodeBlock { "Title block"; 50; 0; false; }
categories_2 = Categories("OST_TitleBlocks")
all_family_types_of_category = Custom[All Family Types Of Category](category=categories_2)  # package Clockwork for Dynamo 3.x; Gets all family types/symbols of a given category in the model.
boolean_2 = BoolSelector(false)
clean_2 = List.Clean(list=all_family_types_of_category, preserveIndices=boolean_2)
sort = List.Sort(list=clean_2)
name_4 = Element.Name(element=sort)
dropdown_data_2 = Custom[DropDown Data](InputName=code_block_9.out0, Keys=name_4, Values=sort)

# group: GUI
code_block_10 = CodeBlock { "Dependent views and sheets"; "Run"; "Cancel"; true; 900; 500; 130; }
list_create = List.Create(item0=listview_data, item1=listview_data_2, item2=dropdown_data, item3=textbox_data, item4=textbox_data_2, item5=boolean_input, item6=boolean_input_2, item7=dropdown_data_2)
multipleinputform = Custom[MultipleInputForm ++](Description_optional=code_block_10.out0, Logo_optional=file_path, ButtonText_optional=code_block_10.out1, Inputs=list_create, Toggle=code_block_10.out3, CancelButtonText_optional=code_block_10.out2, MaxHeight_optional=code_block_10.out4, Width_optional=code_block_10.out5, LabelWidth_optional=code_block_10.out6)  # package Data-Shapes; Create a form with multiple inputs. see www.data-shapes.net for tutorials and infos!

code_block_11 = CodeBlock(out=multipleinputform.User_Inputs) { out[0]; out[1]; out[2]; out[3]; out[4]; out[5]; out[6]; out[7]; }

# group: Level
code_block_12 = CodeBlock(level=code_block_11.out0) { level; }

# group: floor plan
list_create_2 = List.Create(item0=code_block_12)
filterByBoolMask_2 = List.FilterByBoolMask(list=list_create_2, mask=code_block_11.out5)
flatten = List.Flatten(list=filterByBoolMask_2.in)
byLevel = FloorPlanView.ByLevel(level=flatten)

# group: view name
code_block_13 = CodeBlock { "View Name"; }
name_5 = Level.Name(level=code_block_12)
code_block_14 = CodeBlock { " "; }
add = code_block_14 + code_block_11.out3
add_2 = name_5 + add
setParameterByName = Element.SetParameterByName(element=byLevel, parameterName=code_block_13, value=add_2)
code_block_15 = CodeBlock { 0; 1; 2; 3; 4; }

# group: Scope box selection
code_block_16 = CodeBlock { " "; }
code_block_17 = CodeBlock(scope=code_block_11.out1) { scope; }
name_6 = Element.Name(element=code_block_17)
add_3 = code_block_16 + name_6
string_from_object = FromObject(obj=add_3)

# group: Dependent views from scope boxes and levels code allows for up to 4 levels
code_block_18 = CodeBlock { 0; 1; 2; 3; 4; }
getItemAtIndex = List.GetItemAtIndex(list=add_2, index=code_block_18.out0)
add_4 = getItemAtIndex + string_from_object
getItemAtIndex_2 = List.GetItemAtIndex(list=add_2, index=code_block_18.out1)
add_5 = getItemAtIndex_2 + string_from_object
getItemAtIndex_3 = List.GetItemAtIndex(list=add_2, index=code_block_18.out2)
add_6 = getItemAtIndex_3 + string_from_object
getItemAtIndex_4 = List.GetItemAtIndex(list=add_2, index=code_block_18.out3)
add_7 = getItemAtIndex_4 + string_from_object
getItemAtIndex_5 = List.GetItemAtIndex(list=add_2, index=code_block_18.out4)
add_8 = getItemAtIndex_5 + string_from_object
getItemAtIndex_6 = List.GetItemAtIndex(list=byLevel, index=code_block_15.out0)
views_createdependents = Custom[© Views.CreateDependents](views=getItemAtIndex_6, dependentNames=add_4)  # package Crumple; Given a list of names and a view, will generate a set of dependent views upon that view with those names.
getItemAtIndex_7 = List.GetItemAtIndex(list=byLevel, index=code_block_15.out1)
views_createdependents_2 = Custom[© Views.CreateDependents](views=getItemAtIndex_7, dependentNames=add_5)
getItemAtIndex_8 = List.GetItemAtIndex(list=byLevel, index=code_block_15.out2)
views_createdependents_3 = Custom[© Views.CreateDependents](views=getItemAtIndex_8, dependentNames=add_6)
getItemAtIndex_9 = List.GetItemAtIndex(list=byLevel, index=code_block_15.out3)
views_createdependents_4 = Custom[© Views.CreateDependents](views=getItemAtIndex_9, dependentNames=add_7)
getItemAtIndex_10 = List.GetItemAtIndex(list=byLevel, index=code_block_15.out4)
views_createdependents_5 = Custom[© Views.CreateDependents](views=getItemAtIndex_10, dependentNames=add_8)

# group: Sheet naming listed
join = List.Join(list0=add_4, list1=add_5, list2=add_6, list3=add_7, list4=add_8)

# group: Sheet numbering
list_create_3 = List.Create(item0=join)
filterByBoolMask_3 = List.FilterByBoolMask(list=list_create_3, mask=code_block_11.out6)
flatten_2 = List.Flatten(list=filterByBoolMask_3.in)
code_block_19 = CodeBlock(sn=code_block_11.out4) { sn; }
count = List.Count(list=join)
code_block_20 = CodeBlock { 1; }
sequence = Sequence(start=code_block_19, amount=count, step=code_block_20)
string_from_object_2 = FromObject(obj=sequence)
code_block_21 = CodeBlock { 0; }
number_to_rounded_string = Custom[Number to Rounded String](Number=string_from_object_2, Decimals=code_block_21)  # package Data-Shapes; Returns rounded number to specified number of decimals as string

# group: Sheet title population
byNameNumberTitleBlock = Sheet.ByNameNumberTitleBlock(sheetName=flatten_2, sheetNumber=number_to_rounded_string, titleBlockFamilyType=code_block_11.out7)

# group: view dependents output
join_2 = List.Join(list0=views_createdependents.dependentViews, list1=views_createdependents_2.dependentViews, list2=views_createdependents_3.dependentViews, list3=views_createdependents_4.dependentViews, list4=views_createdependents_5.dependentViews)
flatten_3 = List.Flatten(list=join_2)

# group: View scale
code_block_22 = CodeBlock { 50; }
setScale = View.SetScale(view=flatten_3, scale=code_block_22)

# group: Add views to sheets
code_block_23 = CodeBlock { 560; }
code_block_24 = CodeBlock { 420; }
byCoordinates = Point.ByCoordinates(x=code_block_23, y=code_block_24)
bySheetViewLocation = Viewport.BySheetViewLocation(sheet=byNameNumberTitleBlock, view=setScale, location=byCoordinates)

# group: View template
code_block_25 = CodeBlock { "View Template"; }
setParameterByName_2 = Element.SetParameterByName(element=byLevel, parameterName=code_block_25, value=code_block_11.out2)

code_block_26 = CodeBlock { "Scope Box"; }
setParameterByName_3 = Element.SetParameterByName(element=views_createdependents_3.dependentViews, parameterName=code_block_26, value=code_block_17)
setParameterByName_4 = Element.SetParameterByName(element=views_createdependents_2.dependentViews, parameterName=code_block_26, value=code_block_17)
setParameterByName_5 = Element.SetParameterByName(element=views_createdependents.dependentViews, parameterName=code_block_26, value=code_block_17)
setParameterByName_6 = Element.SetParameterByName(element=views_createdependents_4.dependentViews, parameterName=code_block_26, value=code_block_17)
setParameterByName_7 = Element.SetParameterByName(element=views_createdependents_5.dependentViews, parameterName=code_block_26, value=code_block_17)
