# Dynamo graph Single View&Sheet-UI-OTB_script.dyn (Dynamo 2.13.1.3887)
# packages: Data-Shapes 2025.3.118, Clockwork for Dynamo 3.x 3.3.0

# group: Icon user defined
file_path = Filename("..\..\5f234.png")

# group: levels list user selection
code_block = CodeBlock { "Levels"; 70; 0; false; }
categories = Categories("OST_Levels")
all_elements_of_category = ElementsOfCategory(Category=categories)
name = ElementType.Name(elementType=all_elements_of_category)
listview_data = Custom[Listview Data](InputName=code_block.out0, Keys=name, Values=all_elements_of_category, Height_optionnal=code_block.out1, SortItems_optionnal=code_block.out3, ShowId_optionnal=code_block.out3)  # package Data-Shapes; Create data for ListView input in UI.MultiInputForm ++ . Check out www.data-shapes.net for more infos.

# group: scope box dropdown user selection
code_block_2 = CodeBlock { "Scope Box"; 0; }
code_block_3 = CodeBlock { Category.ByName("Scope Boxes"); }
all_elements_of_category_2 = ElementsOfCategory(Category=code_block_3)
name_2 = ElementType.Name(elementType=all_elements_of_category_2)
dropdown_data = Custom[DropDown Data](InputName=code_block_2.out0, Keys=name_2, Values=all_elements_of_category_2, DefaultValueIndex=code_block_2.out1)  # package Data-Shapes; Create data for DropDown input in UI.MultiInputForm ++ . Check out www.data-shapes.net for more infos.

# group: view template dropdown user selection
code_block_4 = CodeBlock { "View Template"; 0; true; }
categories_2 = Categories("OST_Views")
all_elements_of_category_3 = ElementsOfCategory(Category=categories_2)
boolean = BoolSelector(false)
clean = List.Clean(list=all_elements_of_category_3, preserveIndices=boolean)
isViewTemplate = View.IsViewTemplate(view=clean)
filterByBoolMask = List.FilterByBoolMask(list=clean, mask=isViewTemplate)
name_3 = ElementType.Name(elementType=filterByBoolMask.in)
code_block_5 = CodeBlock(a=name_3) { a; }
dropdown_data_2 = Custom[DropDown Data](InputName=code_block_4.out0, Keys=code_block_5, Values=filterByBoolMask.in)

# group: view/sheet name -user text input
code_block_6 = CodeBlock { "View/Sheet Name"; "Combined Layout"; }
textbox_data = Custom[TextBox Data](InputName=code_block_6.out0, DefaultText=code_block_6.out1)  # package Data-Shapes; Create Data for TextBox input in UI.MultipleInputForm ++ . Check out www.data-shapes.net for more informations

# group: sheet no- user numerical input
code_block_7 = CodeBlock { "Sheet No. Set"; "5000"; true; }
textbox_data_2 = Custom[TextBox Data](InputName=code_block_7.out0, DefaultText=code_block_7.out1, IsNumberEntry=code_block_7.out2)

# group: create views switch on off
code_block_8 = CodeBlock { "View"; true; "Create view"; }
boolean_input = Custom[Boolean input](InputName=code_block_8.out0, DefaultValue=code_block_8.out1, SideText=code_block_8.out2)  # package Data-Shapes; Creates a boolean input for UI.MultipleInputForm ++ . Check out www.data-shapes.net for more infos!

# group: create sheets switch on off
code_block_9 = CodeBlock { "Sheet"; true; "Create sheet check both to add views to sheets"; }
boolean_input_2 = Custom[Boolean input](InputName=code_block_9.out0, DefaultValue=code_block_9.out1, SideText=code_block_9.out2)

# group: title blocks dropdown user selected
code_block_10 = CodeBlock { "Title Blocks"; 80; 0; false; }
categories_3 = Categories("OST_TitleBlocks")
all_family_types_of_category = Custom[All Family Types Of Category](category=categories_3)  # package Clockwork for Dynamo 3.x; Gets all family types/symbols of a given category in the model.
boolean_2 = BoolSelector(false)
clean_2 = List.Clean(list=all_family_types_of_category, preserveIndices=boolean_2)
name_4 = ElementType.Name(elementType=clean_2)
dropdown_data_3 = Custom[DropDown Data](InputName=code_block_10.out0, Keys=name_4, Values=clean_2, Sorted_optional=code_block_10.out3)

# group: GUI
code_block_11 = CodeBlock { "Create Views and Sheets"; "Run"; "Cancel"; 850; 500; 150; }
list_create = List.Create(item0=listview_data, item1=dropdown_data, item2=dropdown_data_2, item3=textbox_data, item4=textbox_data_2, item5=boolean_input, item6=boolean_input_2, item7=dropdown_data_3)
boolean_3 = BoolSelector(true)
multipleinputform = Custom[MultipleInputForm ++](Description_optional=code_block_11.out0, Logo_optional=file_path, ButtonText_optional=code_block_11.out1, Inputs=list_create, Toggle=boolean_3, CancelButtonText_optional=code_block_11.out2, MaxHeight_optional=code_block_11.out3, Width_optional=code_block_11.out4, LabelWidth_optional=code_block_11.out5)  # package Data-Shapes; Create a form with multiple inputs. see www.data-shapes.net for tutorials and infos!

code_block_12 = CodeBlock(out=multipleinputform.User_Inputs) { out[0]; out[1]; out[2]; out[3]; out[4]; out[5]; out[6]; out[7]; }

# group: levels selected
levels = CodeBlock(a=code_block_12.out0) { a; }

# group: view & sheet name
name_5 = Level.Name(level=levels)
code_block_13 = CodeBlock { " "; }
add = code_block_13 + code_block_12.out3
add_2 = name_5 + add

# group: sheet check on/off
list_create_2 = List.Create(item0=add_2)
code_block_14 = CodeBlock(a=code_block_12.out6) { a; }
filterByBoolMask_2 = List.FilterByBoolMask(list=list_create_2, mask=code_block_14)
flatten = List.Flatten(list=filterByBoolMask_2.in)

# group: no of sheets by levels
count = List.Count(list=levels)

# group: sheet no
code_block_15 = CodeBlock { 1; }
sequence = Sequence(start=code_block_12.out4, amount=count, step=code_block_15)
string_from_object = FromObject(object=sequence)
code_block_16 = CodeBlock { 0; }
number_to_rounded_string = Custom[Number to Rounded String](Number=string_from_object, Decimals=code_block_16)  # package Data-Shapes; Returns rounded number to specified number of decimals as string

# group: sheet-output
byNameNumberTitleBlock = Sheet.ByNameNumberTitleBlock(sheetName=flatten, sheetNumber=number_to_rounded_string, titleBlockFamilyType=code_block_12.out7)

# group: view check on/off
list_create_3 = List.Create(item0=levels)
code_block_17 = CodeBlock(a=code_block_12.out5) { a; }
filterByBoolMask_3 = List.FilterByBoolMask(list=list_create_3, mask=code_block_17)
flatten_2 = List.Flatten(list=filterByBoolMask_3.in)

# group: view
byLevel = FloorPlanView.ByLevel(level=flatten_2)
code_block_18 = CodeBlock { "View Name"; }
setParameterByName = Element.SetParameterByName(element=byLevel, parameterName=code_block_18, value=add_2)

# group: View scale
code_block_19 = CodeBlock { 50; }
setScale = View.SetScale(view=setParameterByName, scale=code_block_19)

# group: Add view to sheet-output
code_block_20 = CodeBlock { 560; }
code_block_21 = CodeBlock { 420; }
byCoordinates = Point.ByCoordinates(x=code_block_20, y=code_block_21)
bySheetViewLocation = Viewport.BySheetViewLocation(sheet=byNameNumberTitleBlock, view=setScale, location=byCoordinates)

# group: View template
code_block_22 = CodeBlock { "View Template"; }
setParameterByName_2 = Element.SetParameterByName(element=byLevel, parameterName=code_block_22, value=code_block_12.out2)

# group: number sequencing from list
code_block_23 = CodeBlock { 00; }
sequence_2 = Sequence(start=code_block_23, amount=count, step=code_block_15)
string_from_object_2 = FromObject(obj=sequence_2)
code_block_24 = CodeBlock { 2; }
code_block_25 = CodeBlock { 0; }
string_from_object_3 = FromObject(obj=code_block_25)
padLeft = String.PadLeft(string=string_from_object_2, newLength=code_block_24, padChars=string_from_object_3)

# group: scope box
code_block_26 = CodeBlock { "Scope Box"; }
setParameterByName_3 = Element.SetParameterByName(element=byLevel, parameterName=code_block_26, value=code_block_12.out1)
